# Grasshopper definition FacadeEmbed_JinQiao_Podium.gh (Grasshopper 1.0.7)
# plug-ins: EleFront, Wombat, Hare, Pufferfish

# ---- group: 钢结构预埋
crv = Curve([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])

# ---- group: 板槽
inblock = InsertBlock(BlockName="xxx", SourcePlane=PlaneXY(0, 0, 0))

# ----
# 单体选型
list = ValueList({"板埋": 0, "槽埋": 1, "板槽埋": 2}, selected="槽埋")
list_2 = ValueList({"顶埋": 0, "侧埋": 1}, selected="顶埋")
panel = Panel(list)
panel_2 = Panel(list_2)

# ----
# Find Block and Curve
data = Data(["PX-GLAZ-F2$0$PX-GLAZ-F2$0$fin", "PX-GLAZ-F2$0$PX-GLAZ-F1$0$标准块", "PX-GLAZ-F2$0$PX-GLAZ-F1$0$fin", "PX-GLAZ-F2$0$PX-GLAZ-F2$0$标准块", "PX-GLAZ-F2$0$PX-GLAZ-F3$0$标准块", "PX-GLAZ-F2$0$T3T"])
crv_2 = Curve(<curve referenced from the Rhino model>)
crv_3 = Curve(<curve referenced from the Rhino model>)
listblockd = ListBlockDocument()
panel_3 = Panel(data)
layer = ObjectLayer(Guid=crv_2)  # -> LayerIndex, LayerPathName
disc = Discontinuity(Curve=crv_3, Level=1)  # -> Points, Parameters
panel_4 = Panel(layer.LayerPathName)
panel_5 = Panel(listblockd)
refblock = ReferenceBlockByName(BlockName=panel_3)
deblock = DeconstructBlock(Block=refblock)  # -> Name, Plane, Geometry
reflay = ReferenceByLayer(LayerName=panel_4)
merge = Merge(Data2=reflay)

# ---- group: 结构线
crv_4 = Curve(<curve referenced from the Rhino model>)

# ----
# 平面定位INPUT
crv_5 = Curve([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])

# ---- group: 玻璃线
玻璃线 = Curve(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)
玻璃线_2 = Curve(<curve referenced from the Rhino model>)
玻璃线_3 = Curve(<curve referenced from the Rhino model>)

# ---- group: 定位竖料
crv_6 = Curve([<curve referenced from the Rhino model> x300])
crv_7 = Curve([<curve referenced from the Rhino model> x180])
crv_8 = Curve([<curve referenced from the Rhino model> x383])

# ---- group: 混凝土
# 板埋几何INPUT
list_3 = ValueList({"C15": 0, "C20": 1, "C25": 2, "C30": 3, "C35": 4, "C40": 5}, selected="C35")

# ---- group: 钢筋牌号
list_4 = ValueList({"HPB300": 0, "HRB400": 1}, selected="HPB300")

# ---- group: 直径
list_5 = ValueList({"10": 0, "12": 1, "16": 2, "18": 3, "20": 4, "25": 5}, selected="12")

# ---- group: 列
list_6 = ValueList({"2X": 0, "3X": 1, "4X": 2}, selected="3X")

# ---- group: 行
list_7 = ValueList({"2Y": 0, "3Y": 1, "4Y": 2}, selected="2Y")

# ---- group: 锚筋间距
s_x = Slider(22, range=14..60, expression="X*5")
s_y = Slider(22, range=14..60, expression="X*5")

# ----
crv_9 = Curve([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])
reflay_2 = ReferenceByLayer(LayerName="Arch_curve_angular_withLocation")
reflay_3 = ReferenceByLayer(LayerName="Arch_curve_angular")
reflay_4 = ReferenceByLayer(LayerName="ArchCurve_Whole")
reflay_5 = ReferenceByLayer(LayerName="Arch_curve_doubleLine")
reflay_6 = ReferenceByLayer(LayerName="Arch_curve_smooth")

# ----
# 槽埋-角部选择
list_8 = ValueList({"槽埋角部-L形": 0, "槽埋角部-I形": 1}, selected="槽埋角部-I形")

join = JoinCurves(Curves=crv_9, Preserve=False)

crv_10 = Curve(reflay_5)
disc_2 = Discontinuity(Curve=graft(crv_10), Level=1)  # -> Points, Parameters
number_slider = Slider(300, range=0..1000)
crv_cp = CurveClosestPoint(Point=disc_2.Points, Curve=graft(crv_10))  # -> Point, Parameter, Distance
neg = Negative(Value=number_slider)
eval = EvaluateCurve(Curve=graft(crv_10), Parameter=crv_cp.Parameter)  # -> flatten(Point), Tangent, flatten(Angle)
filter = StreamFilter(Gate=Toggle(True), Stream0=number_slider, Stream1=neg)
deg = Degrees(Radians=eval.Angle)
offset = OffsetCurve(Curve=crv_10, Distance=expr("-X", filter), Corners=1)
panel_6 = Panel(deg)
larger = LargerThan(FirstNumber=deg, SecondNumber=Slider(60, range=0..100))  # -> LargerThan, OrEqualTo
disc_3 = Discontinuity(Curve=offset, Level=1)  # -> flatten(Points), Parameters
dispatch = Dispatch(List=eval.Point, DispatchPattern=larger.LargerThan)  # -> ListA, ListB
end = EndPoints(Curve=crv_10)  # -> Start, End
data_2 = Data(dispatch.ListA)
pull = PullPoint(Point=data_2, Geometry=flatten(offset), ClosestOnly=True)  # -> ClosestPoint, Distance
testpoint = TestPoint(archPoint=pull.ClosestPoint, crvPoint=disc_3.Points)  # -> out, specialPt; inputs archPoint: list of Point3d, crvPoint: list of Point3d
# ---------- testpoint: C# ----------
    List<int> passIndex = new List<int>();

    for(int i = 0; i < archPoint.Count; i++){
      foreach(Point3d t in crvPoint){
        if(archPoint[i].X == t.X && archPoint[i].Y == t.Y && archPoint[i].Z == t.Z){
          Print("pass");
          passIndex.Add(i);}
      }
    }

    specialPt = passIndex;
# ---------- end testpoint ----------

clscrv = CloseCurve(Curve=reflay_4, CloseType=0, Bulge=0.5, Tolerance=0)  # -> Closed, R
crv_11 = Curve(reflay_6)
disc_4 = Discontinuity(Curve=graft(crv_11), Level=1)  # -> Points, Parameters
crv_cp_2 = CurveClosestPoint(Point=disc_4.Points, Curve=graft(crv_11))  # -> Point, Parameter, Distance
eval_2 = EvaluateCurve(Curve=graft(crv_11), Parameter=crv_cp_2.Parameter)  # -> flatten(Point), Tangent, flatten(Angle)
deg_2 = Degrees(Radians=eval_2.Angle)
offset_2 = OffsetCurve(Curve=clscrv.Closed, Distance=expr("-X", Slider(300, range=0..1000)), Corners=1)
panel_7 = Panel(deg_2)
larger_2 = LargerThan(FirstNumber=deg_2, SecondNumber=Slider(60, range=0..100))  # -> LargerThan, OrEqualTo
disc_5 = Discontinuity(Curve=offset_2, Level=1)  # -> flatten(Points), Parameters
dispatch_2 = Dispatch(List=eval_2.Point, DispatchPattern=larger_2.LargerThan)  # -> ListA, ListB
end_2 = EndPoints(Curve=crv_11)  # -> Start, End
data_3 = Data(dispatch_2.ListA)
pull_2 = PullPoint(Point=data_3, Geometry=flatten(offset_2), ClosestOnly=True)  # -> ClosestPoint, Distance
testpoint_2 = TestPoint(archPoint=pull_2.ClosestPoint, crvPoint=disc_5.Points)  # -> out, specialPt; inputs archPoint: list of Point3d, crvPoint: list of Point3d; same code as testpoint

flip = FlipCurve(Curve=玻璃线)  # -> Curve, Flag
boundary = BoundarySurfaces(Edges=join)
filter_2 = StreamFilter(Gate=Toggle(True), Stream0=玻璃线, Stream1=flip.Curve)
sunion = SolidUnion(Breps=boundary)
offset_3 = OffsetCurve(Curve=filter_2, Distance=expr("-x", Slider(375, range=0..1000)), Corners=1)
area = Area(Geometry=sunion)  # -> Area, Centroid
pt = Point(area.Centroid)
explode = Explode(Curve=offset_3, Recursive=True)  # -> Segments, Vertices

# ---- group: 钢结构预埋
# 随文件数据请勿覆盖
crv_12 = Curve([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])

# ---- group: 槽埋3D
brep = Brep(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)

# ----
pt_2 = Point(explode.Vertices)
entwine = Entwine(Branch00=sunion, Branch01=pt, FlattenInputs=True)
max = Maximum(A=s_x, B=s_y)
flip_2 = FlipMatrix(Data=entwine)
filter_3 = StreamFilter(Gate=list_3, Stream0=7.2, Stream1=9.6, Stream2=11.9, Stream3=14.3, Stream4=16.7, Stream5=19.1)
filter_4 = StreamFilter(Gate=list_4, Stream0=270, Stream1=360)
filter_5 = StreamFilter(Gate=list_5, Stream0=10, Stream1=12, Stream2=16, Stream3=18, Stream4=20, Stream5=25)
filter_6 = StreamFilter(Gate=list_3, Stream0=0.91, Stream1=1.1, Stream2=1.27, Stream3=1.43, Stream4=1.57, Stream5=1.71)
filter_7 = StreamFilter(Gate=list_4, Stream0=0.16, Stream1=0.14)
addition = Addition(A=list_6, B=1)
addition_2 = Addition(A=list_7, B=1)
division = Division(A=max, B=8)

# ---- group: 建筑定位轮廓
item = ListItem(List=flip_2, Index="0", Wrap=True)  # -> flatten(Item)

# ---- group: 埋件定位点
item_2 = ListItem(List=flip_2, Index="-1", Wrap=True)  # -> flatten(Item)

# ----
t = Integer(division)
panel_8 = Panel(filter_6)
panel_9 = Panel(filter_3)
panel_10 = Panel(filter_7)
min = Minimum(A=filter_4, B=300)
brep_2 = Brep(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)
panel_11 = Panel(min)
expression = Expression(A=filter_7, fy=filter_4, ft=filter_6, d=filter_5, Expression="(int((0.6*1.1*A*fy/ft*d)/5)+1)*5")

# ----
# SmoothCurve-阴角&阳角
item_3 = ListItem(List=pull_2.ClosestPoint, Index=testpoint_2.specialPt, Wrap=True)
cull_i = CullIndex(List=pull_2.ClosestPoint, Indices=testpoint_2.specialPt, Wrap=True)

# ----
# SmoothCurve-阴角&阳角
item_4 = ListItem(List=pull.ClosestPoint, Index=testpoint.specialPt, Wrap=True)
cull_i_2 = CullIndex(List=pull.ClosestPoint, Indices=testpoint.specialPt, Wrap=True)

# ----
# 导入槽埋模型
brep_3 = Brep(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)

# ---- group: 槽埋
# 槽埋Modeling
brep_4 = Brep(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)
bbox = BoundingBox(Content=brep_3, Plane=PlaneXY(0, 0, 0))  # -> Box, Box_2
debox = DeconstructBox(Box=bbox.Box)  # -> Plane, X, Y, Z
area_2 = Area(Geometry=brep_3)  # -> Area, Centroid
pdecon = Deconstruct(Point=area_2.Centroid)  # -> XComponent, YComponent, ZComponent
dedomain = DeconstructDomain(Domain=debox.Z)  # -> Start, End
xy = XYPlane(Origin=Point(0, 0, 0))
pt_3 = ConstructPoint(XCoordinate=pdecon.XComponent, YCoordinate=pdecon.YComponent, ZCoordinate=dedomain.End)
pl_origin = PlaneOrigin(Base=xy, Origin=pt_3)
xy_2 = XYPlane(Origin=Point(0, 0, 0))
orient = Orient(Geometry=brep_3, Source=pl_origin, Target=xy_2)  # -> Geometry, Transform

# ----
edges = BrepEdges(Brep=bbox.Box)  # -> Naked, Interior, NonManifold
item_5 = ListItem(List=edges.Interior, Index="5", Wrap=True)
item_6 = ListItem(List=edges.Interior, Index="4", Wrap=True)
clx = CurveLine(Curve=item_6, Line=item_5)  # -> Points, Params, Count
Y = UnitY(Factor=item_5)
rotate = Rotate(Geometry=brep_3, Angle=1.570796327, Plane=clx.Points)  # -> Geometry, Transform
move = Move(Geometry=rotate.Geometry, Motion=Y)  # -> Geometry, Transform
merge_2 = Merge(Data1=brep_3, Data2=move.Geometry)  # -> flatten(Result)
sunion_2 = SolidUnion(Breps=merge_2)
bbox_2 = BoundingBox(Content=sunion_2, Plane=PlaneXY(0, 0, 0))  # -> Box, Box_2
area_3 = Area(Geometry=sunion_2)  # -> Area, Centroid
debox_2 = DeconstructBox(Box=bbox_2.Box)  # -> Plane, X, Y, Z
pdecon_2 = Deconstruct(Point=area_3.Centroid)  # -> XComponent, YComponent, ZComponent
dedomain_2 = DeconstructDomain(Domain=debox_2.Z)  # -> Start, End
pt_4 = ConstructPoint(XCoordinate=pdecon_2.XComponent, YCoordinate=pdecon_2.YComponent, ZCoordinate=dedomain_2.End)
xy_3 = XYPlane(Origin=Point(0, 0, 0))
pl_origin_2 = PlaneOrigin(Base=xy_3, Origin=pt_4)
xy_4 = XYPlane(Origin=Point(0, 0, 0))
orient_2 = Orient(Geometry=sunion_2, Source=pl_origin_2, Target=xy_4)  # -> Geometry, Transform

# ----
# 导入槽埋模型
brep_5 = Brep(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)

filter_8 = StreamFilter(Gate=list_8, Stream0=orient_2.Geometry, Stream1=orient.Geometry)
entwine_2 = Entwine(Branch00=orient.Geometry, Branch01=filter_8, FlattenInputs=True)
crv_13 = Curve(offset_3)
crv_14 = Curve([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])
crv_15 = Curve(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)
merge_3 = Merge(Data1=crv_14, Data2=crv_15)

# ---- group: 阴阳角区分
cp = ClosestPoint(Point=pt_2, Cloud=item_2)  # -> ClosestPoint, CPIndex, Distance
item_7 = ListItem(List=item_2, Index=cp.CPIndex, Wrap=True)
crv_cp_3 = CurveClosestPoint(Point=item_7, Curve=offset_3)  # -> Point, Parameter, Distance
eval_3 = EvaluateCurve(Curve=offset_3, Parameter=crv_cp_3.Parameter)  # -> Point, Tangent, Angle

# ----
# 板槽埋Modeling
multiplication = Multiplication(A=s_x, B=addition)
multiplication_2 = Multiplication(A=s_y, B=addition_2)
recgrid = Rectangular(Plane=PlaneXY(0, 0, 0), SizeX=s_x, SizeY=s_y, ExtentX=addition, ExtentY=addition_2)  # -> Cells, Points
直径 = Text(filter_5)
division_2 = Division(A=multiplication, B=2)
division_3 = Division(A=multiplication_2, B=2)
vec = VectorXYZ(XComponent=expr("-x", division_2), YComponent=expr("-x", division_3), ZComponent=0)  # -> Vector, Length
move_2 = Move(Geometry=recgrid.Points, Motion=vec.Vector)  # -> Geometry, Transform
division_4 = Division(A=直径, B=2)
cyl = Cylinder(Base=move_2.Geometry, Radius=division_4, Length=expr("-x", expression))
X = UnitX(Factor=直径)
multiplication_3 = Multiplication(A=直径, B=6)
edges_2 = BrepEdges(Brep=cyl)  # -> Naked, Interior, NonManifold
item_8 = ListItem(List=edges_2.Naked, Index=0, Wrap=True)
max_2 = Maximum(A=multiplication_3, B=70)
move_3 = Move(Geometry=item_8, Motion=X)  # -> Geometry, Transform
multiplication_4 = Multiplication(A=max_2, B=2)
addition_3 = Addition(A=multiplication, B=multiplication_4)
addition_4 = Addition(A=multiplication_2, B=multiplication_4)
division_5 = Division(A=t, B=2)
expression_2 = Expression(x=addition_4, Expression="Ceiling(x/10)*10/2")
expression_3 = Expression(x=addition_3, Expression="Ceiling(x/10)*10/2")
round = Round(Number=division_5)  # -> Nearest, Floor, Ceiling
multiplication_5 = Multiplication(A=round.Ceiling, B=2)
dom = ConstructDomain(DomainStart=expr("-x", expression_2), DomainEnd=expression_2)
dom_2 = ConstructDomain(DomainStart=expr("-x", expression_3), DomainEnd=expression_3)
box = DomainBox(Base=PlaneXY(0, 0, 0), X=dom_2, Y=dom, Z=multiplication_5)
Z = UnitZ(Factor=expr("-x", multiplication_5))

multiplication_6 = Multiplication(A=直径, B=5)

Z_2 = UnitZ(Factor=multiplication_6)
extr = Extrude(Base=move_3.Geometry, Direction=Z_2)
cap = CapHoles(Brep=[extr, cyl])
merge_4 = Merge(Data1=cap, Data2=box)
flatten = FlattenTree(Tree=merge_4, Path="{0}")
move_4 = Move(Geometry=flatten, Motion=Z)  # -> Geometry, Transform

brep_6 = Brep(move_4.Geometry)

# ----
# 槽埋+板埋合并
bbox_3 = BoundingBox(Content=brep_5, Plane=PlaneXY(0, 0, 0))  # -> Box, Box_2
debox_3 = DeconstructBox(Box=bbox_3.Box)  # -> Plane, X, Y, Z
area_4 = Area(Geometry=brep_5)  # -> Area, Centroid
dedomain_3 = DeconstructDomain(Domain=debox_3.Z)  # -> Start, End
pdecon_3 = Deconstruct(Point=area_4.Centroid)  # -> XComponent, YComponent, ZComponent
xy_5 = XYPlane(Origin=Point(0, 0, 0))
pt_5 = ConstructPoint(XCoordinate=pdecon_3.XComponent, YCoordinate=pdecon_3.YComponent, ZCoordinate=dedomain_3.End)
pl_origin_3 = PlaneOrigin(Base=xy_5, Origin=pt_5)
xy_6 = XYPlane(Origin=Point(0, 0, 0))
orient_3 = Orient(Geometry=brep_5, Source=pl_origin_3, Target=xy_6)  # -> Geometry, Transform
bbox_4 = BoundingBox(Content=orient_3.Geometry, Plane=PlaneXY(0, 0, 0))  # -> Box, Box_2
sdiff = SolidDifference(BrepsA=move_4.Geometry, BrepsB=bbox_4.Box)
sunion_3 = SolidUnion(Breps=[sdiff, orient_3.Geometry])  # -> flatten(Result)

edges_3 = BrepEdges(Brep=bbox_3.Box)  # -> Naked, Interior, NonManifold
item_9 = ListItem(List=edges_3.Interior, Index="5", Wrap=True)
item_10 = ListItem(List=edges_3.Interior, Index="4", Wrap=True)
clx_2 = CurveLine(Curve=item_10, Line=item_9)  # -> Points, Params, Count
Y_2 = UnitY(Factor=item_9)
rotate_2 = Rotate(Geometry=brep_5, Angle=1.570796327, Plane=clx_2.Points)  # -> Geometry, Transform
move_5 = Move(Geometry=rotate_2.Geometry, Motion=Y_2)  # -> Geometry, Transform
merge_5 = Merge(Data1=brep_5, Data2=move_5.Geometry)  # -> flatten(Result)
sunion_4 = SolidUnion(Breps=merge_5)
bbox_5 = BoundingBox(Content=sunion_4, Plane=PlaneXY(0, 0, 0))  # -> Box, Box_2
area_5 = Area(Geometry=sunion_4)  # -> Area, Centroid
debox_4 = DeconstructBox(Box=bbox_5.Box)  # -> Plane, X, Y, Z
pdecon_4 = Deconstruct(Point=area_5.Centroid)  # -> XComponent, YComponent, ZComponent
dedomain_4 = DeconstructDomain(Domain=debox_4.Z)  # -> Start, End
pt_6 = ConstructPoint(XCoordinate=pdecon_4.XComponent, YCoordinate=pdecon_4.YComponent, ZCoordinate=dedomain_4.End)
xy_7 = XYPlane(Origin=Point(0, 0, 0))
pl_origin_4 = PlaneOrigin(Base=xy_7, Origin=pt_6)
xy_8 = XYPlane(Origin=Point(0, 0, 0))
orient_4 = Orient(Geometry=sunion_4, Source=pl_origin_4, Target=xy_8)  # -> Geometry, Transform

entwine_3 = Entwine(Branch00=sunion_3, Branch01=orient_4.Geometry, FlattenInputs=True)

# ----
# 板埋Modeling
multiplication_7 = Multiplication(A=s_x, B=addition)
multiplication_8 = Multiplication(A=s_y, B=addition_2)
recgrid_2 = Rectangular(Plane=PlaneXY(0, 0, 0), SizeX=s_x, SizeY=s_y, ExtentX=addition, ExtentY=addition_2)  # -> Cells, Points
直径_2 = Text(filter_5)
division_6 = Division(A=multiplication_7, B=2)
division_7 = Division(A=multiplication_8, B=2)
vec_2 = VectorXYZ(XComponent=expr("-x", division_6), YComponent=expr("-x", division_7), ZComponent=0)  # -> Vector, Length
move_6 = Move(Geometry=recgrid_2.Points, Motion=vec_2.Vector)  # -> Geometry, Transform
division_8 = Division(A=直径_2, B=2)
cyl_2 = Cylinder(Base=move_6.Geometry, Radius=division_8, Length=expr("-x", expression))
X_2 = UnitX(Factor=直径_2)
multiplication_9 = Multiplication(A=直径_2, B=6)
edges_4 = BrepEdges(Brep=cyl_2)  # -> Naked, Interior, NonManifold
item_11 = ListItem(List=edges_4.Naked, Index=0, Wrap=True)
max_3 = Maximum(A=multiplication_9, B=70)
move_7 = Move(Geometry=item_11, Motion=X_2)  # -> Geometry, Transform
multiplication_10 = Multiplication(A=max_3, B=2)
addition_5 = Addition(A=multiplication_7, B=multiplication_10)
addition_6 = Addition(A=multiplication_8, B=multiplication_10)
division_9 = Division(A=t, B=2)
expression_4 = Expression(x=addition_6, Expression="Ceiling(x/10)*10/2")
expression_5 = Expression(x=addition_5, Expression="Ceiling(x/10)*10/2")
round_2 = Round(Number=division_9)  # -> Nearest, Floor, Ceiling
multiplication_11 = Multiplication(A=round_2.Ceiling, B=2)
dom_3 = ConstructDomain(DomainStart=expr("-x", expression_4), DomainEnd=expression_4)
dom_4 = ConstructDomain(DomainStart=expr("-x", expression_5), DomainEnd=expression_5)
box_2 = DomainBox(Base=PlaneXY(0, 0, 0), X=dom_4, Y=dom_3, Z=multiplication_11)
Z_3 = UnitZ(Factor=expr("-x", multiplication_11))
move_8 = Move(Geometry=box_2, Motion=Z_3)  # -> Geometry, Transform
Z_4 = UnitZ(Factor=expr("-x", multiplication_11))

multiplication_12 = Multiplication(A=直径_2, B=5)

Z_5 = UnitZ(Factor=multiplication_12)
extr_2 = Extrude(Base=move_7.Geometry, Direction=Z_5)
cap_2 = CapHoles(Brep=[extr_2, cyl_2])
merge_6 = Merge(Data1=cap_2, Data2=box_2)
flatten_2 = FlattenTree(Tree=merge_6, Path="{0}")
move_9 = Move(Geometry=flatten_2, Motion=Z_4)  # -> Geometry, Transform

box_3 = DomainBox(Base=PlaneXY(0, 0, 0), X=dom_4, Y=dom_4, Z=multiplication_11)
merge_7 = Merge(Data1=cap_2, Data2=box_3)
flatten_3 = FlattenTree(Tree=merge_7, Path="{0}")
move_10 = Move(Geometry=flatten_3, Motion=Z_4)  # -> Geometry, Transform
entwine_4 = Entwine(Branch00=move_9.Geometry, Branch01=move_10.Geometry, FlattenInputs=True)

# ---- group: 选单体
板埋or槽埋or板槽埋 = StreamFilter(Gate=list, Stream0=entwine_4, Stream1=entwine_2, Stream2=entwine_3)

# ----
# 三视图
# hidden lines of top+pers view
# move to center
# 如果无法完整的生成埋件的三视图，
# 建议选择埋件的3D在Rhino中将
# Top/Perspective/Front/Right 试图缩放至合适大小后重新运行
panel_12 = Panel("""Top
Perspective
Front
Right""")
m2d_rhino = Make2DRhinoView(Name=panel_12, Clip=True)
make2d = Make2D(Geometry=板埋or槽埋or板槽埋, View=m2d_rhino, TangentEdges=False, TangentSeams=False, AutoComputeMake2D=False)  # -> VisibleCurves, VisibleIndex, VisibleType, HiddenCurves, HiddenIndex, HiddenType
bang = ExplodeTree(Data=make2d.VisibleCurves)  # -> Branch0, Branch1, Branch2, Branch3, Branch4, Branch5, Branch6, Branch7
bang_2 = ExplodeTree(Data=make2d.VisibleCurves)  # -> Branch0, Branch1, Branch2, Branch3, Branch4, Branch5, Branch6, Branch7
divdist = DivideDistance(Curve=make2d.HiddenCurves, Distance=Slider(1, range=0..10))  # -> Points, Tangents, Parameters
graft = GraftTree(Tree=make2d.HiddenCurves, IncludeEmptyLists=True, IncludeNullItems=True)
shatter = Shatter(Curve=graft, Parameters=divdist.Parameters)
dispatch_3 = Dispatch(List=shatter, DispatchPattern=[True, False])  # -> ListA, ListB
crv_16 = Curve(dispatch_3.ListA)
pshift = ShiftPaths(Data=crv_16, Offset=-1)
pshift_2 = ShiftPaths(Data=pshift, Offset=-1)
bang_3 = ExplodeTree(Data=pshift_2)  # -> Branch0, Branch1, Branch2, Branch3, Branch4, Branch5, Branch6, Branch7
bang_4 = ExplodeTree(Data=pshift_2)  # -> Branch0, Branch1, Branch2, Branch3, Branch4, Branch5, Branch6, Branch7
entwine_5 = Entwine(Branch00=bang_4.Branch4, Branch01=bang_2.Branch4, FlattenInputs=True)  # -> flatten(Result)
entwine_6 = Entwine(Branch00=bang_4.Branch5, Branch01=bang_2.Branch5, FlattenInputs=True)  # -> flatten(Result)
entwine_7 = Entwine(Branch00=bang_3.Branch0, Branch01=bang.Branch0, FlattenInputs=True)  # -> flatten(Result)
entwine_8 = Entwine(Branch00=bang_3.Branch1, Branch01=bang.Branch1, FlattenInputs=True)  # -> flatten(Result)
entwine_9 = Entwine(Branch00=entwine_7, Branch01=entwine_8, Branch02=bang.Branch2, Branch03=bang.Branch3, FlattenInputs=True)
entwine_10 = Entwine(Branch00=entwine_5, Branch01=entwine_6, Branch02=bang_2.Branch6, Branch03=bang_2.Branch7, FlattenInputs=True)
group = Group(Objects=entwine_9)
group_2 = Group(Objects=entwine_10)
entwine_11 = Entwine(Branch00=group, Branch01=group_2, FlattenInputs=True)
pshift_3 = ShiftPaths(Data=entwine_11, Offset=-1)
pshift_4 = ShiftPaths(Data=entwine_11, Offset=-1)
number_slider_2 = Slider(2, range=0..10)
# Rhino 文件中导入的块名
boxprop = BoxProperties(Box=pshift_3)  # -> Center, Diagonal, Area, Volume, Degeneracy
pt_7 = Point(Point(957.9296072, 367.7685097, 0))
pt_8 = Point("0,0,0")
recgrid_3 = Rectangular(
    Plane=pt_7,
    SizeX=Slider(12, range=1..20, expression="X*50"),
    SizeY=Slider(10, range=1..20, expression="X*50"),
    ExtentX=number_slider_2,
    ExtentY=number_slider_2)  # -> Cells, Points
vec2pt = Vector2Pt(PointA=boxprop.Center, PointB=pt_8, Unitize=False)  # -> Vector, Length
flatten_4 = FlattenTree(Tree=recgrid_3.Points, Path="{0}")
move_11 = Move(Geometry=pshift_4, Motion=vec2pt.Vector)  # -> flatten(Geometry), Transform
orient_5 = Orient(Geometry=flatten(move_11.Geometry), Source=PlaneXY(0, 0, 0), Target=flatten_4)  # -> Geometry, Transform
cull_i_3 = CullIndex(List=orient_5.Geometry, Indices="-1", Wrap=True)
split = SplitList(List=cull_i_3, Index="4")  # -> ListA, ListB
data_4 = Data(split.ListA)
data_5 = Data(split.ListB)
entwine_12 = Entwine(Branch00=data_4, Branch01=data_5, FlattenInputs=True)
geo = Geometry(entwine_12)

# ---- group: 单体定Top/Side
item_12 = ListItem(List=geo, Index=2, Wrap=True)
item_13 = ListItem(List=geo, Index=Slider(0, range=0..10), Wrap=True)
cluster = Cluster(G=item_13)
cluster_2 = Cluster(G=item_12)

# ---- group: 单体定Top/Side / Top/Side
filter_9 = StreamFilter(Gate=list_2, Stream0=cluster, Stream1=cluster_2)

# ---- group: 单体定Top/Side / Monomer + Top/Side
filter_10 = StreamFilter(Gate=list, Stream0=filter_9, Stream1=filter_9, Stream2=filter_9)  # -> flatten(Stream)

# ---- group: Block
# 自定义块所在图层
# 自定义块所在图层颜色
# 自定义块名称
panel_13 = Panel("Embeded::Embeded")
layer_2 = DefineLayer(Name=panel_13, Color=ColourSwatch(SwatchColor=RGB(255, 0, 0)))
attributes = DefineObjectAttributes(Layer=layer_2)
block = DefineBlock(Geometry=filter_9, Attributes=attributes, BlockName="Steel Plate", BasePlane=PlaneXY(0, 0, 0))

# ---- group: 正常+阳角+阴角区分
cull_i_4 = CullIndex(List=item_2, Indices=cp.CPIndex, Wrap=True)
crv_17 = Curve(offset_3)
crv_18 = Curve(flip.Curve)
explode_2 = Explode(Curve=crv_17, Recursive=True)  # -> Segments, Vertices
explode_3 = Explode(Curve=crv_18, Recursive=True)  # -> Segments, Vertices

# ---- group: 阴角定位-细化
item_14 = ListItem(List=item, Index=cp.CPIndex, Wrap=True)

# ---- group: 大面
# 大面埋件布置
number_slider_3 = Slider(0.002, range=0..0.01)
filter_11 = StreamFilter(Gate=list_2, Stream0=expression_4, Stream1=number_slider_3)
filter_12 = StreamFilter(Gate=list, Stream0=filter_11, Stream1=expression_4, Stream2=filter_11)
offset_4 = OffsetCurve(Curve=offset_3, Distance=expr("-x", filter_12), Plane=PlaneXY(0, 0, 0), Corners=1)

# ---- group: 阴阳角区分 (continued)
crv_cp_4 = CurveClosestPoint(Point=item_7, Curve=offset_4)  # -> Point, Parameter, Distance
vec2pt_2 = Vector2Pt(PointA=crv_cp_4.Point, PointB=crv_cp_3.Point, Unitize=False)  # -> expr("-x", Vector), Length
angle = Angle(VectorA=eval_3.Tangent, VectorB=vec2pt_2.Vector)  # -> Angle, Reflex
deg_3 = Degrees(Radians=angle.Angle)
smaller = SmallerThan(FirstNumber=deg_3, SecondNumber=89)  # -> SmallerThan, OrEqualTo
dispatch_4 = Dispatch(List=item_7, DispatchPattern=smaller.SmallerThan)  # -> ListA, ListB

# ---- group: 正常+阳角+阴角区分 (continued)
data_6 = Data(dispatch_4.ListA)
data_7 = Data(dispatch_4.ListB)
pull_3 = PullPoint(Point=data_6, Geometry=crv_17, ClosestOnly=True)  # -> ClosestPoint, Distance
pull_4 = PullPoint(Point=data_7, Geometry=crv_18, ClosestOnly=True)  # -> ClosestPoint, Distance
c_script = CSharpScript(archPoint=pull_3.ClosestPoint, crvPoint=explode_2.Vertices)  # -> out, specialPt; inputs archPoint: list of Point3d, crvPoint: list of Point3d; same code as testpoint
c_script_2 = CSharpScript(archPoint=pull_4.ClosestPoint, crvPoint=explode_3.Vertices)  # -> out, specialPt; inputs archPoint: list of Point3d, crvPoint: list of Point3d; same code as testpoint
cull_i_5 = CullIndex(List=data_6, Indices=c_script.specialPt, Wrap=True)

# ---- group: 阴角定位-细化 (continued)
dispatch_5 = Dispatch(List=item_14, DispatchPattern=smaller.SmallerThan)  # -> ListA, ListB
item_15 = ListItem(List=dispatch_5.ListB, Index=c_script_2.specialPt, Wrap=True)
join_2 = JoinCurves(Curves=item_15, Preserve=False)
explode_4 = Explode(Curve=join_2, Recursive=True)  # -> Segments, Vertices
crv_19 = Curve(simplify(explode_4.Segments))
len = Length(Curve=crv_19)
sort = SortList(Keys=len, ValuesA=crv_19)  # -> Keys, ValuesA
item_16 = ListItem(List=sort.ValuesA, Index=0, Wrap=True)  # -> Item2, Item1, Item
crv_20 = Curve([item_16.Item2, item_16.Item1])
disc_6 = Discontinuity(Curve=crv_20, Level=1)  # -> Points, Parameters
item_17 = ListItem(List=disc_6.Points, Index=0, Wrap=True)
pull_5 = PullPoint(Point=disc_6.Points, Geometry=pt_2, ClosestOnly=True)  # -> ClosestPoint, Distance
crv_cp_5 = CurveClosestPoint(Point=disc_6.Points, Curve=offset_3)  # -> Point, Parameter, Distance
sort_2 = SortList(Keys=pull_5.Distance, ValuesA=crv_cp_5.Point)  # -> Keys, ValuesA

# ---- group: 正常+阳角+阴角区分 / 正常-遗漏
cull_i_6 = CullIndex(List=data_7, Indices=c_script_2.specialPt, Wrap=True)

# ---- group: 正常+阳角+阴角区分 / 阴角定位点
item_18 = ListItem(List=data_7, Index=c_script_2.specialPt, Wrap=True)

# ---- group: 正常+阳角+阴角区分 / 正常定位点
merge_8 = Merge(Data1=cull_i_4, Data2=cull_i_6, Data3=cull_i_5)

# ---- group: 正常+阳角+阴角区分 / 阳角定位点
item_19 = ListItem(List=data_6, Index=c_script.specialPt, Wrap=True)

# ---- group: 阴角定位-细化 / 阴角-2点定位
item_20 = ListItem(List=sort_2.ValuesA, Index=0, Wrap=True)

# ----
# 阳角埋件布置
pt_9 = Point(item_19)
explode_5 = Explode(Curve=crv_13, Recursive=True)  # -> Segments, Vertices
cp_2 = ClosestPoint(Point=pt_9, Cloud=explode_5.Vertices)  # -> ClosestPoint, CPIndex, Distance
cir = Circle(Plane=cp_2.ClosestPoint, Radius=Slider(150, range=0..1000))
pt_10 = Point(cp_2.ClosestPoint)
ccx = CurveCurve(CurveA=cir, CurveB=offset_3)  # -> Points, ParamsA, ParamsB
item_21 = ListItem(List=ccx.Points, Index=0, Wrap=True)  # -> Item, Item1
ln = Line(StartPoint=graft(pt_10), EndPoint=graft(item_21.Item))  # -> flatten(Line)
ln_2 = Line(StartPoint=graft(pt_10), EndPoint=graft(item_21.Item1))  # -> flatten(Line)
item_22 = ListItem(List=filter_10, Index="1", Wrap=True)
pl = ConstructPlane(Origin=pt_10, XAxis=ln, YAxis=ln_2)
bbox_6 = BoundingBox(Content=graft(item_22), Plane=PlaneXY(0, 0, 0))  # -> Box, Box_2
srf = Surface(bbox_6.Box)
explode_6 = Explode(Curve=srf, Recursive=True)  # -> Segments, Vertices
item_23 = ListItem(List=explode_6.Vertices, Index=0, Wrap=True)  # -> Item, Item1, Item2
ln_3 = Line(StartPoint=graft(item_23.Item1), EndPoint=graft(item_23.Item2))
ln_4 = Line(StartPoint=graft(item_23.Item1), EndPoint=graft(item_23.Item))
ln_5 = Line(StartPoint=graft(item_23.Item1), EndPoint=graft(item_23.Item))
ln_6 = Line(StartPoint=graft(item_23.Item1), EndPoint=graft(item_23.Item2))
pl_2 = ConstructPlane(Origin=item_23.Item1, XAxis=ln_6, YAxis=ln_5)
pl_3 = ConstructPlane(Origin=item_23.Item1, XAxis=ln_4, YAxis=ln_3)
orient_6 = Orient(Geometry=item_22, Source=pl_3, Target=pl)  # -> Geometry, Transform
orient_7 = Orient(Geometry=item_22, Source=pl_2, Target=pl)  # -> Geometry, Transform
merge_9 = Merge(Data1=orient_6.Geometry, Data2=orient_7.Geometry)
filter_13 = StreamFilter(Gate=list_2, Stream0=orient_6.Geometry, Stream1=merge_9)
bbox_7 = BoundingBox(Content=filter_13, Plane=PlaneXY(0, 0, 0))  # -> Box, Box_2
entwine_13 = Entwine(Branch00=filter_13, Branch01=bbox_7.Box, FlattenInputs=True)
flip_3 = FlipMatrix(Data=entwine_13)
item_24 = ListItem(List=flip_3, Index=-1, Wrap=True)  # -> flatten(Item)
item_25 = ListItem(List=flip_3, Index="0", Wrap=True)  # -> flatten(Item)

# ---- group: 阴角
# 阴角埋件布置
explode_7 = Explode(Curve=crv_13, Recursive=True)  # -> Segments, Vertices
cp_3 = ClosestPoint(Point=item_18, Cloud=explode_7.Vertices)  # -> ClosestPoint, CPIndex, Distance
pshift_5 = ShiftPaths(Data=item_20, Offset=-1)
crv_cp_6 = CurveClosestPoint(Point=pshift_5, Curve=offset_4)  # -> Point, Parameter, Distance
crv_cp_7 = CurveClosestPoint(Point=pshift_5, Curve=offset_3)  # -> Point, Parameter, Distance
vec2pt_3 = Vector2Pt(PointA=crv_cp_6.Point, PointB=crv_cp_7.Point, Unitize=False)  # -> expr("-x", Vector), Length
eval_4 = EvaluateCurve(Curve=offset_3, Parameter=crv_cp_7.Parameter)  # -> Point, Tangent, Angle
pl_4 = ConstructPlane(Origin=crv_cp_7.Point, XAxis=eval_4.Tangent, YAxis=vec2pt_3.Vector)
orient_8 = Orient(Geometry=block, Source=PlaneXY(0, 0, 0), Target=pl_4)  # -> Geometry, Transform

# ---- group: 大面 (continued)
crv_cp_8 = CurveClosestPoint(Point=merge_8, Curve=offset_4)  # -> Point, Parameter, Distance
crv_cp_9 = CurveClosestPoint(Point=merge_8, Curve=offset_3)  # -> Point, Parameter, Distance
vec2pt_4 = Vector2Pt(PointA=crv_cp_8.Point, PointB=crv_cp_9.Point, Unitize=False)  # -> expr("-x", Vector), Length
eval_5 = EvaluateCurve(Curve=offset_3, Parameter=crv_cp_9.Parameter)  # -> Point, Tangent, Angle
pl_5 = ConstructPlane(Origin=crv_cp_9.Point, XAxis=eval_5.Tangent, YAxis=vec2pt_4.Vector)
orient_9 = Orient(Geometry=block, Source=PlaneXY(0, 0, 0), Target=pl_5)  # -> flatten(Geometry), Transform

# ---- group: Datea / 2
lng = ListLength(List=orient_9.Geometry)
division_10 = Division(A=lng, B=2)
split_2 = SplitList(List=orient_9.Geometry, Index=division_10)  # -> ListA, ListB
data_8 = Data(split_2.ListA)

# ----
bbox_8 = BoundingBox(Content=data_8, Plane=PlaneXY(0, 0, 0))  # -> Box, Box_2
entwine_14 = Entwine(Branch00=data_8, Branch01=bbox_8.Box, FlattenInputs=True)
flip_4 = FlipMatrix(Data=entwine_14)
item_26 = ListItem(List=flip_4, Index=-1, Wrap=True)  # -> flatten(Item)
item_27 = ListItem(List=flip_4, Index="0", Wrap=True)  # -> flatten(Item)
阴角 = Geometry(orient_8.Geometry)

# ---- group: Monomer + Side/Top / Monomer Type
filter_14 = StreamFilter(Gate=list, Stream0=item_24, Stream1=item_24, Stream2=item_24)

# ----
# 槽埋-角部倾斜时
bbox_9 = BoundingBox(Content=item_24, Plane=PlaneXY(0, 0, 0))  # -> Box, Box_2
ln_7 = Line(StartPoint=pt_9, EndPoint=pt_10)
debrep = DeconstructBrep(Brep=bbox_9.Box)  # -> Faces, Edges, Vertices
deplane = DeconstructPlane(Plane=ln_7)  # -> Origin, XAxis, YAxis, ZAxis
len_2 = Length(Curve=debrep.Edges)
sort_3 = SortList(Keys=len_2, ValuesA=debrep.Edges)  # -> Keys, reverse(ValuesA)
amp = Amplitude(Vector=deplane.XAxis, Amplitude=Slider(63.5, range=10..100))
item_28 = ListItem(List=sort_3.ValuesA, Index=0, Wrap=True)  # -> Item, Item1, Item2
item_29 = ListItem(List=sort_3.ValuesA, Index=0, Wrap=True)
move_12 = Move(Geometry=deplane.Origin, Motion=amp)  # -> Geometry, Transform
len_3 = Length(Curve=item_29)
end_3 = EndPoints(Curve=item_28.Item2)  # -> Start, End
end_4 = EndPoints(Curve=item_28.Item1)  # -> Start, End
ln_8 = Line(StartPoint=deplane.Origin, EndPoint=move_12.Geometry)
ln_9 = Line(StartPoint=move_12.Geometry, EndPoint=deplane.Origin)
avr = Average(Input=[end_4.Start, end_4.End])
ln_10 = Line(StartPoint=end_3.Start, EndPoint=end_3.End)
ln_11 = Line(StartPoint=end_4.Start, EndPoint=avr)
c_script_3 = CSharpScript(iReset=Toggle(True), turns=Slider(30, range=0..100), steps=Slider(10, range=0..10))  # -> out, num; inputs numDefault: Double, iReset: Boolean, turns: Int32, steps: Double
# ---------- c_script_3: C# ----------
    if(iReset){
      number = 0;}

    for(int i = 0; i < turns;i++){
      number = number + steps;
      numStore.Add(number);
      Print(number.ToString());}

    num = numStore;
# ---------- c_script_3: C# additional code ----------
  double number = 0;
  List <double> numStore = new List<double>();
# ---------- end c_script_3 ----------
pl_6 = ConstructPlane(Origin=avr, XAxis=ln_11, YAxis=ln_10)
panel_14 = Panel(c_script_3.num)
amp_2 = Amplitude(Vector=ln_7, Amplitude=graft(c_script_3.num))

item_30 = ListItem(List=flatten(len_3), Index=0, Wrap=True)

ln_12 = Line(StartPoint=pt_9, EndPoint=pt_10)
move_13 = Move(Geometry=pt_10, Motion=ln_12)  # -> Geometry, Transform
ccx_2 = CurveCurve(CurveA=cir, CurveB=offset_3)  # -> Points, ParamsA, ParamsB
item_31 = ListItem(List=ccx_2.Points, Index=0, Wrap=True)  # -> flatten(Item), flatten(Item1)
ln_13 = Line(StartPoint=pt_10, EndPoint=item_31.Item)
ln_14 = Line(StartPoint=pt_10, EndPoint=move_13.Geometry)
ln_15 = Line(StartPoint=pt_10, EndPoint=item_31.Item1)
angle_2 = Angle(VectorA=ln_13, VectorB=ln_14)  # -> Angle, Reflex
angle_3 = Angle(VectorA=ln_15, VectorB=ln_14)  # -> Angle, Reflex
deg_4 = Degrees(Radians=angle_2.Angle)
deg_5 = Degrees(Radians=angle_3.Angle)
item_32 = ListItem(List=ln_14, Index=Slider(3, range=0..4), Wrap=True)
tan = Tangent(Value=degrees(deg_4))
entwine_15 = Entwine(Branch00=ln_13, Branch01=tan, FlattenInputs=True)
tan_2 = Tangent(Value=degrees(deg_5))
division_11 = Division(A=tan, B=tan_2)
panel_15 = Panel(deg_5)
panel_16 = Panel(deg_4)
addition_7 = Addition(A=division_11, B=1)
division_12 = Division(A="1", B=addition_7)
subtraction = Subtraction(A="1", B=division_12)
num = Number(division_12)
larger_3 = LargerThan(FirstNumber=tan, SecondNumber=tan_2)  # -> LargerThan, OrEqualTo

amp_3 = Amplitude(Vector=ln_9, Amplitude=expr("x/2", flatten(item_30)))
amp_4 = Amplitude(Vector=ln_8, Amplitude=expr("x/2", flatten(item_30)))
move_14 = Move(Geometry=pt_10, Motion=amp_3)  # -> Geometry, Transform
move_15 = Move(Geometry=pt_10, Motion=amp_4)  # -> Geometry, Transform
ln_16 = Line(StartPoint=move_14.Geometry, EndPoint=move_15.Geometry)

crv_21 = Curve(ln_16)
mp = Midpoint(Curve=crv_21)
eval_6 = EvaluateCurve(Curve=crv_21, Parameter=subtraction)  # -> Point, Tangent, Angle
eval_7 = EvaluateCurve(Curve=crv_21, Parameter=num)  # -> Point, Tangent, Angle
dispatch_6 = Dispatch(List=eval_6.Point, DispatchPattern=larger_3.OrEqualTo)  # -> ListA, ListB
dispatch_7 = Dispatch(List=eval_7.Point, DispatchPattern=larger_3.OrEqualTo)  # -> ListA, ListB
pt_11 = Point(dispatch_6.ListB)
pt_12 = Point(dispatch_7.ListA)
merge_10 = Merge(Data1=pt_12, Data2=pt_11)
pull_6 = PullPoint(Point=merge_10, Geometry=graft(mp), ClosestOnly=True)  # -> ClosestPoint, Distance
panel_17 = Panel(merge_10)
sort_4 = SortList(Keys=pull_6.Distance, ValuesA=merge_10)  # -> Keys, ValuesA
item_33 = ListItem(List=sort_4.ValuesA, Index=0, Wrap=True)  # -> flatten(Item)
ln_17 = Line(StartPoint=item_33, EndPoint=mp)
panel_18 = Panel(item_33)
move_16 = Move(Geometry=crv_21, Motion=ln_17)  # -> Geometry, Transform

# ---- group: 正常和阳角 - BoundingBox — 测Intersection
entwine_16 = Entwine(Branch00=flip.Curve, Branch01=offset_3, FlattenInputs=True)
flip_5 = FlipMatrix(Data=entwine_16)
item_34 = ListItem(List=flip_5, Index=0, Wrap=True)  # -> Item, Item1

# ----
move_17 = Move(Geometry=move_16.Geometry, Motion=amp_2)  # -> Geometry, Transform
ccx_3 = CurveCurve(CurveA=move_17.Geometry, CurveB=crv_13)  # -> Points, ParamsA, ParamsB
item_35 = ListItem(List=ccx_3.Points, Index=0, Wrap=True)
item_36 = ListItem(List=ccx_3.Points, Index="-1", Wrap=True)
pshift_6 = ShiftPaths(Data=item_35, Offset=-1)
pshift_7 = ShiftPaths(Data=item_36, Offset=-1)
flip_6 = FlipMatrix(Data=pshift_6)
flip_7 = FlipMatrix(Data=pshift_7)
pt_13 = Point(flip_6)
pt_14 = Point(flip_7)
pull_7 = PullPoint(Point=pt_13, Geometry=graft(mp), ClosestOnly=True)  # -> ClosestPoint, Distance
pull_8 = PullPoint(Point=pt_14, Geometry=graft(mp), ClosestOnly=True)  # -> ClosestPoint, Distance
sort_5 = SortList(Keys=pull_7.Distance, ValuesA=pt_13)  # -> Keys, ValuesA
sort_6 = SortList(Keys=pull_8.Distance, ValuesA=pt_14)  # -> Keys, ValuesA
item_37 = ListItem(List=sort_5.ValuesA, Index="-1", Wrap=True)
item_38 = ListItem(List=sort_6.ValuesA, Index="-1", Wrap=True)
ln_18 = Line(StartPoint=item_38, EndPoint=item_37)

end_5 = EndPoints(Curve=ln_18)  # -> Start, End

avr_2 = Average(Input=[end_5.Start, end_5.End])
pl_7 = ConstructPlane(Origin=avr_2, XAxis=ln_18, YAxis=graft(ln_7))
orient_10 = Orient(Geometry=graft(item_25), Source=pl_6, Target=pl_7)  # -> Geometry, Transform
orient_11 = Orient(Geometry=graft(item_24), Source=pl_6, Target=pl_7)  # -> Geometry, Transform

filter_15 = StreamFilter(Gate=list_8, Stream0=item_24, Stream1=orient_11.Geometry)

# ---- group: Monomer + Side/Top / Monomer Type (continued)
filter_16 = StreamFilter(Gate=list, Stream0=item_24, Stream1=filter_15, Stream2=item_24)

# ---- group: Monomer + Side/Top / Top/Side
filter_17 = StreamFilter(Gate=list_2, Stream0=filter_16, Stream1=filter_14)

# ----
filter_18 = StreamFilter(Gate=list_8, Stream0=item_25, Stream1=orient_10.Geometry)

# ---- group: 阳角分类
filter_19 = StreamFilter(Gate=list, Stream0=item_25, Stream1=filter_18, Stream2=item_25)
filter_20 = StreamFilter(Gate=list, Stream0=item_25, Stream1=item_25, Stream2=item_25)
filter_21 = StreamFilter(Gate=list_2, Stream0=filter_19, Stream1=filter_20)

# ----
阳角 = Geometry(filter_21)

# ---- group: 正常和阳角 - BoundingBox — 测Intersection (continued)
c_script_4 = CSharpScript(BrepMain=item_26, BrepStay=filter_17)  # -> out, BrepInters, BrepRemain, IndexM, IndexS; inputs BrepMain: list of Brep, BrepStay: list of Brep
# ---------- c_script_4: C# ----------
    List<Brep> BrepI = new List<Brep>();
    List<Brep> BrepR = new List<Brep>();
    List<int> num = new List<int>();
    List<int> numS = new List<int>();


    double tolr = Rhino.RhinoDoc.ActiveDoc.ModelAbsoluteTolerance;

    for(int j = 0; j < BrepMain.Count;j++){
      for(int i = 0; i < BrepStay.Count;i++){
        bool test = Rhino.Geometry.Intersect.Intersection.BrepBrep(BrepMain[j], BrepStay[i], tolr, out crv, out pts);
        if(test && crv.Length != 0){
          tryThis = true;
          numS.Add(i);
          break;}
        else{
          tryThis = false;}
      }
      if(tryThis){
        BrepI.Add(BrepMain[j]);
        num.Add(j);
      }
      else{
        BrepR.Add(BrepMain[j]);
      }
    }



    BrepInters = BrepI;
    BrepRemain = BrepR;
    IndexM = num;
    IndexS = numS;
# ---------- c_script_4: C# additional code ----------
  Rhino.Geometry.Curve[] crv;
  Rhino.Geometry.Point3d[] pts;
  bool tryThis;
# ---------- end c_script_4 ----------
item_39 = ListItem(List=item_26, Index=c_script_4.IndexM, Wrap=True)  # -> graft(Item)
item_40 = ListItem(List=filter_17, Index=c_script_4.IndexS, Wrap=True)  # -> graft(Item)
cull_i_7 = CullIndex(List=item_27, Indices=c_script_4.IndexM, Wrap=True)
item_41 = ListItem(List=item_27, Index=c_script_4.IndexM, Wrap=True)  # -> graft(Item)
area_6 = Area(Geometry=item_39)  # -> Area, Centroid
bbx = BrepBrep(BrepA=item_39, BrepB=item_40)  # -> simplify(Curves), Points
area_7 = Area(Geometry=bbx.Curves)  # -> Area, Centroid
ln_19 = Line(StartPoint=area_6.Centroid, EndPoint=area_7.Centroid)
mp_2 = Midpoint(Curve=ln_19)
scale = Scale(Geometry=ln_19, Center=mp_2, Factor=Slider(1000000, range=0..1000000))  # -> Geometry, Transform
ccx_4 = CurveCurve(CurveA=scale.Geometry, CurveB=bbx.Curves)  # -> Points, ParamsA, ParamsB
item_42 = ListItem(List=ccx_4.Points, Index=0, Wrap=True)  # -> Item, Item1
ln_20 = Line(StartPoint=item_42.Item1, EndPoint=item_42.Item)
move_18 = Move(Geometry=item_41, Motion=ln_20)  # -> simplify(Geometry), Transform
bbox_10 = BoundingBox(Content=move_18.Geometry, Plane=PlaneXY(0, 0, 0))  # -> Box, Box_2

# ----
# 这里如果跑红也不要紧，
# 说明单体没有出现相撞的情况
area_8 = Area(Geometry=bbox_10.Box)  # -> Area, Centroid

# ---- group: 正常和阳角 - BoundingBox — 测Intersection (continued)
entwine_17 = Entwine(Branch00=move_18.Geometry, Branch01=area_8.Centroid, FlattenInputs=True)
flip_8 = FlipMatrix(Data=entwine_17)
item_43 = ListItem(List=flip_8, Index="0", Wrap=True)  # -> flatten(Item)
item_44 = ListItem(List=flip_8, Index="-1", Wrap=True)  # -> flatten(Item)
pull_9 = PullPoint(Point=item_44, Geometry=item_34.Item, ClosestOnly=True)  # -> flatten(ClosestPoint), Distance
pull_10 = PullPoint(Point=item_44, Geometry=item_34.Item1, ClosestOnly=True)  # -> flatten(ClosestPoint), Distance
vec2pt_5 = Vector2Pt(PointA=item_44, PointB=pull_9.ClosestPoint, Unitize=False)  # -> Vector, Length
vec2pt_6 = Vector2Pt(PointA=item_44, PointB=pull_10.ClosestPoint, Unitize=False)  # -> Vector, Length
multiplication_13 = Multiplication(A=vec2pt_5.Vector, B=vec2pt_6.Vector)
larger_4 = LargerThan(FirstNumber=multiplication_13, SecondNumber=0)  # -> LargerThan, OrEqualTo
dispatch_8 = Dispatch(List=item_43, DispatchPattern=larger_4.LargerThan)  # -> ListA, ListB

# ---- group: Normal
geo_2 = Geometry(cull_i_7)

# ---- group: Normal-Move
移动 = Geometry(dispatch_8.ListA)

# ----
# PLAN Results
merge_11 = Merge(Data1=geo_2, Data2=阳角, Data3=移动, Data4=阴角)

# ==== cluster Cluster
G = ClusterInput()
rotate = Rotate(Geometry=G, Angle=3.141592654, Plane=PlaneXY(0, 0, 0))  # -> Geometry, Transform
boxprop = BoxProperties(Box=rotate.Geometry)  # -> Center, Diagonal, Area, Volume, Degeneracy
bbox = BoundingBox(Content=rotate.Geometry, Plane=PlaneXY(0, 0, 0))  # -> Box, Box_2
debox = DeconstructBox(Box=bbox.Box)  # -> Plane, X, Y, Z
pdecon = Deconstruct(Point=boxprop.Center)  # -> XComponent, YComponent, ZComponent
dedomain = DeconstructDomain(Domain=debox.Y)  # -> Start, End
pt = ConstructPoint(XCoordinate=pdecon.XComponent, YCoordinate=dedomain.Start, ZCoordinate=pdecon.ZComponent)
xy = XYPlane(Origin=Point(0, 0, 0))
pl_origin = PlaneOrigin(Base=xy, Origin=pt)
orient = Orient(Geometry=rotate.Geometry, Source=pl_origin, Target=xy)  # -> Geometry, Transform
G_2 = ClusterOutput(orient.Geometry)
